# Grasshopper definition test.gh (Grasshopper 0.9.76)
# plug-ins: MeshEdit Components, Circulation

pt = Point(Point(45.16585842, 4.051641229, 0))
geo = Geometry(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)
geo_2 = Geometry([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])
pt_2 = Point(Point(6.409937586, 4.755443623, 0))
agent = Agent(Name="agent1", Origin="start", Destination="end", Count=Slider(100, range=0..100))  # -> flatten(Agent)
node = Node(Position=pt, Name="start", Floor="floor1")
node_2 = Node(Position=pt_2, Name="end", Floor="floor1")
floor = Floor(Boundary=geo, Name="floor1")
barrier = Barrier(Boundary=geo_2, Floor="floor1")
env = Environment(Entities=[floor, barrier, node, node_2, agent], Resolution=Slider(3, range=0..10), Run=Toggle(False))

bmap = BarrierMap(Environment=env, FloorName="floor1")  # -> Mesh, Values
gradient = Gradient(LowerLimit=0, UpperLimit=1, Parameter=bmap.Values, stops=[0: RGB(0, 128, 0), 0.5: RGB(255, 255, 0), 1: RGB(255, 0, 0)])
explode = MeshExplode(Mesh=bmap.Mesh, Interpolate=False)
preview = CustomPreview(Geometry=explode, Shader=gradient)

omap = OccupancyMap(Environment=env, FloorName="floor1", Generation=Slider(13, range=0..100))  # -> Mesh, Values
apaths = AgentPaths(Environment=env, AgentName="agent1")  # -> Mesh, Indexes, Log
bnd = Bounds(Numbers=omap.Values)

gradient_2 = Gradient(
    LowerLimit=0,
    UpperLimit=Slider(44, range=0..100),
    Parameter=omap.Values,
    stops=[0: RGB(234, 38, 0), 0.25: RGB(234, 126, 0), 0.5: RGB(254, 244, 84), 0.75: RGB(173, 203, 249), 1: RGB(75, 107, 169)])
explode_2 = MeshExplode(Mesh=omap.Mesh, Interpolate=False)
preview_2 = CustomPreview(Geometry=explode_2, Shader=gradient_2)

panel = Panel(apaths.Log)

facen = FaceNormals(Mesh=apaths.Mesh)  # -> Centers, Normals
item = ListItem(List=facen.Centers, Index=apaths.Indexes, Wrap=True)
pline = PolyLine(Vertices=item, Closed=False)

panel_2 = Panel(bnd)
